# Grasshopper definition CarboCrocSampleProject.gh (Grasshopper 1.0.7)
# plug-ins: CarboCroc

# ---- group: GEOMETRY
number_slider = Slider(9, range=0..50)
number_slider_2 = Slider(0.169, range=0.1..1)
number_slider_3 = Slider(0.292, range=0.1..1)
pt = ConstructPoint(XCoordinate=number_slider, YCoordinate=0, ZCoordinate=0)
pt_2 = ConstructPoint(XCoordinate=number_slider, YCoordinate=number_slider, ZCoordinate=0)
pt_3 = ConstructPoint(XCoordinate=0, YCoordinate=number_slider, ZCoordinate=0)
pt_4 = ConstructPoint(XCoordinate=0, YCoordinate=0, ZCoordinate=0)
num = Number(number_slider)
multiplication = Multiplication(A=number_slider_2, B="-1")
vec = VectorXYZ(XComponent=number_slider_2, YComponent=number_slider_2, ZComponent=0)  # -> Vector, Length
vec_2 = VectorXYZ(XComponent=multiplication, YComponent=multiplication, ZComponent=0)  # -> Vector, Length
pt_5 = ConstructPoint(XCoordinate=0, YCoordinate=0, ZCoordinate=0)
pline = PolyLine(Vertices=[pt_4, pt, pt_2, pt_3], Closed=True)
vec_3 = VectorXYZ(XComponent=0, YComponent=0, ZComponent=number_slider_3)  # -> Vector, Length
vec_4 = VectorXYZ(XComponent=0, YComponent=0, ZComponent=Slider(9, range=0..50))  # -> Vector, Length
move = Move(Geometry=pt_5, Motion=vec.Vector)  # -> Geometry, Transform
srf = Surface(pline)
move_2 = Move(Geometry=pt_5, Motion=vec_2.Vector)  # -> Geometry, Transform
rec_2pt = Rectangle2Pt(Plane=PlaneXY(0, 0, 0), PointA=move.Geometry, PointB=move_2.Geometry, Radius=0)  # -> Rectangle, Length
extr = Extrude(Base=srf, Direction=vec_3.Vector)
srf_2 = Surface(rec_2pt.Rectangle)
multiplication_2 = Multiplication(A=number_slider_3, B="1000")
num_2 = Number(num)
extr_2 = Extrude(Base=srf_2, Direction=vec_4.Vector)
move_3 = Move(Geometry=extr, Motion=vec_4.Vector)  # -> Geometry, Transform
join = TextJoin(Text=[multiplication_2, " THK RC SLAB"])
vec_5 = VectorXYZ(XComponent=num_2, YComponent=0, ZComponent=0)  # -> Vector, Length
vec_6 = VectorXYZ(XComponent=num_2, YComponent=num_2, ZComponent=0)  # -> Vector, Length
vec_7 = VectorXYZ(XComponent=0, YComponent=num_2, ZComponent=0)  # -> Vector, Length
move_4 = Move(Geometry=extr_2, Motion=[vec_5.Vector, vec_6.Vector, vec_7.Vector])  # -> Geometry, Transform
panel = Panel(join)
geo = Geometry(move_3.Geometry)
geo_2 = Geometry([move_4.Geometry, extr_2])

# ----
volume = Volume(Geometry=geo)  # -> Volume, Centroid
volume_2 = Volume(Geometry=geo_2)  # -> Volume, Centroid

# ---- group: Settings
boolean_toggle = BooleanToggle(True)  # "A1-A3"
a4 = BooleanToggle(True)
a5 = BooleanToggle(True)
boolean_toggle_2 = BooleanToggle(True)  # "B1-B6"
boolean_toggle_3 = BooleanToggle(True)  # "C1-C4"
D = BooleanToggle(False)
sequestration = BooleanToggle(True)
additional = BooleanToggle(True)
carbo_life_switches = CarboLifeSwitches(
    A1A3=boolean_toggle,
    A4=a4,
    A5=a5,
    B1B6=boolean_toggle_2,
    C1C4=boolean_toggle_3,
    D=D,
    Seq=sequestration,
    Extra=additional)  # -> Message, CarboSwitches
panel_2 = Panel(carbo_life_switches.Message)

# ---- group: CarboCalc
material = Materials({"Metal - Steel Generic": 0, "Masonry - Brick - EDP": 1, "Concrete - Mortar": 2, "Concrete - Reinforced Concrete": 3, "Concrete - Screed": 4, "Concrete - Mass Concrete": 5, "Site - Asphalt": 6, "Timber - Structural Timber C24": 7, "Timber - Glulam": 8, "Metal - Reinforcement": 9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}, selected="Concrete - C40/50 - 50% GGBS": 30)
material_2 = Materials({"Metal - Steel Generic": 0, "Masonry - Brick - EDP": 1, "Concrete - Mortar": 2, "Concrete - Reinforced Concrete": 3, "Concrete - Screed": 4, "Concrete - Mass Concrete": 5, "Site - Asphalt": 6, "Timber - Structural Timber C24": 7, "Timber - Glulam": 8, "Metal - Reinforcement": 9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}, selected="Metal - Steel Generic")
list_all_materials = ListMaterials()
list_all_materials_2 = ListMaterials()
item = ListItem(List=list_all_materials, Index=material, Wrap=True)
item_2 = ListItem(List=list_all_materials_2, Index=material_2, Wrap=True)
panel_3 = Panel(item)
panel_4 = Panel(panel)
panel_5 = Panel(item_2)
carbo_life_element = CarboLifeElement(IdGUID="1111", ElementName="RC Slab", MaterialName=panel_3, Volume=volume_2.Volume, Category="Floor")  # -> CarboElement, Message
carbo_life_element_2 = CarboLifeElement(IdGUID="1111", ElementName=panel_4, MaterialName=panel_5, Volume=volume.Volume, Category="Floor")  # -> CarboElement, Message
panel_6 = Panel(carbo_life_element.CarboElement)
panel_7 = Panel(carbo_life_element.Message)
panel_8 = Panel(carbo_life_element_2.CarboElement)
panel_9 = Panel(carbo_life_element_2.Message)
carbo_life_project_solver_by_elements = ProjectElementSolver(
    CarboElements=[carbo_life_element_2.CarboElement, carbo_life_element.CarboElement],
    Switches=carbo_life_switches.CarboSwitches)  # -> Total, CarboProject, Message

# ---- group: Create Project By Groups
material_3 = Materials({"Metal - Steel Generic": 0, "Masonry - Brick - EDP": 1, "Concrete - Mortar": 2, "Concrete - Reinforced Concrete": 3, "Concrete - Screed": 4, "Concrete - Mass Concrete": 5, "Site - Asphalt": 6, "Timber - Structural Timber C24": 7, "Timber - Glulam": 8, "Metal - Reinforcement": 9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}, selected="Metal - Steel Generic")
material_4 = Materials({"Metal - Steel Generic": 0, "Masonry - Brick - EDP": 1, "Concrete - Mortar": 2, "Concrete - Reinforced Concrete": 3, "Concrete - Screed": 4, "Concrete - Mass Concrete": 5, "Site - Asphalt": 6, "Timber - Structural Timber C24": 7, "Timber - Glulam": 8, "Metal - Reinforcement": 9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}, selected="Concrete - C40/50 - 50% GGBS": 30)
list_all_materials_3 = ListMaterials()
list_all_materials_4 = ListMaterials()
item_3 = ListItem(List=list_all_materials_4, Index=material_4, Wrap=True)
item_4 = ListItem(List=list_all_materials_3, Index=material_3, Wrap=True)
select_a_carbomaterial = SelectMaterials(MaterialName=item_4)  # -> CM, String
select_a_carbomaterial_2 = SelectMaterials(MaterialName=item_3)  # -> CM, String
create_a_carbogroup = CarboGroup(CarboElement=carbo_life_element_2.CarboElement, CarboMaterial=select_a_carbomaterial.CM)  # -> CarboGroup, Message
create_a_carbogroup_2 = CarboGroup(CarboElement=carbo_life_element.CarboElement, CarboMaterial=select_a_carbomaterial_2.CM)  # -> CarboGroup, Message
carbo_life_group_project_solver = ProjectGroupSolver(
    CarboGroups=[create_a_carbogroup.CarboGroup, create_a_carbogroup_2.CarboGroup],
    Switches=carbo_life_switches.CarboSwitches)  # -> Total, CarboProject, Message
panel_10 = Panel(carbo_life_group_project_solver.Total)

# ----
panel_11 = Panel(carbo_life_project_solver_by_elements.CarboProject)
panel_12 = Panel(carbo_life_project_solver_by_elements.Message)
panel_13 = Panel(carbo_life_project_solver_by_elements.Total)
split = TextSplit(Text=panel_12, Separators=";")  # -> simplify(Result)
panel_14 = Panel(split)
int = Integer(1)
item_5 = ListItem(List=panel_14, Index=int, Wrap=True)
flatten = FlattenTree(Tree=item_5, Path="{0}")
panel_15 = Panel(flatten)
normalise = CSharpScript(x=panel_15)  # -> out, A; inputs x: list of Double
# ---------- normalise: C# ----------
    List<double> result = new List<double>();

    foreach(double nr in x)
    {
      if(nr < 0)
      {
        result.Add(Math.Round(nr * -1,1));
      }

      if(nr > 0)
      {
        result.Add(Math.Round(nr,1));
      }

    }
    A = result;
# ---------- end normalise ----------
repeat_data = RepeatData(Data=graft(normalise.A), Length=graft(normalise.A))  # -> flatten(Data)
panel_16 = Panel(normalise.A)
pie_chart = PieChart(repeat_data)

# ---- group: Save Project
save_project = SaveACarboLifeProject(Project=carbo_life_group_project_solver.CarboProject, Path="C:\Temp\RhinoSave.clcx", Save=Toggle(True))
panel_17 = Panel(save_project)

# ----
split_2 = TextSplit(Text=carbo_life_group_project_solver.Message, Separators=";")  # -> simplify(Result)
panel_18 = Panel(split_2)
int_2 = Integer(1)
item_6 = ListItem(List=panel_18, Index=int_2, Wrap=True)
flatten_2 = FlattenTree(Tree=item_6, Path="{0}")
panel_19 = Panel(flatten_2)
normalise_2 = CSharpScript(x=panel_19)  # -> out, A; inputs x: list of Double; same code as normalise
repeat_data_2 = RepeatData(Data=graft(normalise_2.A), Length=graft(normalise_2.A))  # -> flatten(Data)
panel_20 = Panel(normalise_2.A)
pie_chart_2 = PieChart(repeat_data_2)
