# Grasshopper definition CarboCrocSampleProject.gh (Grasshopper 1.0.8)
# plug-ins: CarboCroc

panel = Panel("C:\Users\d.veld\source\repos\CarboLifeCalc - NET2\CarboLifeCalc\bin\x64\Debug\net8.0-windows\db\IstructE 3.0.cxml")
panel_2 = Panel("C:\Users\d.veld\source\repos\CarboLifeCalc - NET2\CarboLifeCalc\bin\x64\Debug\net8.0-windows\db\Simplified.cxml")
panel_3 = Panel("C:\Users\d.veld\source\repos\CarboLifeCalc - NET2\CarboLifeCalc\bin\x64\Debug\net8.0-windows\db\Okobaudat.cxml")

# ---- group: Settings
boolean_toggle = BooleanToggle(True)  # "A1-A3"
a4 = BooleanToggle(True)
a5 = BooleanToggle(True)
boolean_toggle_2 = BooleanToggle(True)  # "B1-B6"
boolean_toggle_3 = BooleanToggle(True)  # "C1-C4"
D = BooleanToggle(False)
sequestration = BooleanToggle(True)
additional = BooleanToggle(True)
carbo_life_switches = CarboLifeSwitches(
    A1A3=boolean_toggle,
    A4=a4,
    A5=a5,
    B1B6=boolean_toggle_2,
    C1C4=boolean_toggle_3,
    D=D,
    Seq=sequestration,
    Extra=additional)  # -> Message, CarboSwitches
panel_4 = Panel(carbo_life_switches.Message)

# ---- group: GEOMETRY
number_slider = Slider(9, range=0..50)
number_slider_2 = Slider(0.169, range=0.1..1)
number_slider_3 = Slider(0.292, range=0.1..1)
number_slider_4 = Slider(3, range=0..5)
pt = ConstructPoint(XCoordinate=number_slider, YCoordinate=0, ZCoordinate=0)
pt_2 = ConstructPoint(XCoordinate=number_slider, YCoordinate=number_slider, ZCoordinate=0)
pt_3 = ConstructPoint(XCoordinate=0, YCoordinate=number_slider, ZCoordinate=0)
pt_4 = ConstructPoint(XCoordinate=0, YCoordinate=0, ZCoordinate=0)
num = Number(number_slider)
multiplication = Multiplication(A=number_slider_2, B="-1")
vec = VectorXYZ(XComponent=number_slider_2, YComponent=number_slider_2, ZComponent=0)  # -> Vector, Length
vec_2 = VectorXYZ(XComponent=multiplication, YComponent=multiplication, ZComponent=0)  # -> Vector, Length
pt_5 = ConstructPoint(XCoordinate=0, YCoordinate=0, ZCoordinate=0)
pline = PolyLine(Vertices=[pt_4, pt, pt_2, pt_3], Closed=True)
vec_3 = VectorXYZ(XComponent=0, YComponent=0, ZComponent=number_slider_3)  # -> Vector, Length
vec_4 = VectorXYZ(XComponent=0, YComponent=0, ZComponent=number_slider_4)  # -> Vector, Length
move = Move(Geometry=pt_5, Motion=vec.Vector)  # -> Geometry, Transform
srf = Surface(pline)
move_2 = Move(Geometry=pt_5, Motion=vec_2.Vector)  # -> Geometry, Transform
panel_5 = Panel("1000")
rec_2pt = Rectangle2Pt(Plane=PlaneXY(0, 0, 0), PointA=move.Geometry, PointB=move_2.Geometry, Radius=0)  # -> Rectangle, Length
extr = Extrude(Base=srf, Direction=vec_3.Vector)
srf_2 = Surface(rec_2pt.Rectangle)
num_2 = Number(num)
extr_2 = Extrude(Base=srf_2, Direction=vec_4.Vector)
move_3 = Move(Geometry=extr, Motion=vec_4.Vector)  # -> Geometry, Transform
vec_5 = VectorXYZ(XComponent=num_2, YComponent=0, ZComponent=0)  # -> Vector, Length
vec_6 = VectorXYZ(XComponent=num_2, YComponent=num_2, ZComponent=0)  # -> Vector, Length
vec_7 = VectorXYZ(XComponent=0, YComponent=num_2, ZComponent=0)  # -> Vector, Length
move_4 = Move(Geometry=extr_2, Motion=[vec_5.Vector, vec_6.Vector, vec_7.Vector])  # -> Geometry, Transform
geo = Geometry(move_3.Geometry)
geo_2 = Geometry([move_4.Geometry, extr_2])

# ----
multiplication_2 = Multiplication(A=number_slider_3, B=panel_5)
vec_8 = VectorXYZ(XComponent=0, YComponent=0, ZComponent=number_slider_4)  # -> Vector, Length

# ---- group: GEOMETRY (continued)
join = TextJoin(Text=[multiplication_2, " THK RC SLAB"])
panel_6 = Panel(join)

# ----
move_5 = Move(Geometry=geo, Motion=vec_8.Vector)  # -> Geometry, Transform
move_6 = Move(Geometry=geo_2, Motion=vec_8.Vector)  # -> Geometry, Transform
volume = Volume(Geometry=[geo, move_5.Geometry])  # -> Volume, Centroid
volume_2 = Volume(Geometry=[geo_2, move_6.Geometry])  # -> Volume, Centroid

number_slider_5 = Slider(157, range=0..1000)
number_slider_6 = Slider(217, range=0..1000)
rgb = ColourRGB(Alpha=255, Red=number_slider_5, Green=number_slider_5, Blue=number_slider_5)
rgb_2 = ColourRGB(Alpha=255, Red=number_slider_6, Green=number_slider_6, Blue=number_slider_6)
material = CreateMaterial(Diffuse=rgb, Specular=RGB(255, 255, 255), Emission=RGB(0, 0, 0), Transparency=0, Shine=0)
material_2 = CreateMaterial(Diffuse=rgb_2, Specular=RGB(255, 255, 255), Emission=RGB(0, 0, 0), Transparency=0, Shine=0)
preview = CustomPreview(Geometry=[move_6.Geometry, geo_2], Material=material)
preview_2 = CustomPreview(Geometry=[move_5.Geometry, geo], Material=material_2)

c_script = CSharpScript(geo=geo)  # -> out, guid
# ---------- c_script: C# ----------
// Grasshopper Script Instance
#region Usings
using System;
using System.Linq;
using System.Collections;
using System.Collections.Generic;
using System.Drawing;

using Rhino;
using Rhino.Geometry;

using Grasshopper;
using Grasshopper.Kernel;
using Grasshopper.Kernel.Data;
using Grasshopper.Kernel.Types;
#endregion

public class Script_Instance : GH_ScriptInstance
{
    #region Notes
    /* 
      Members:
        RhinoDoc RhinoDocument
        GH_Document GrasshopperDocument
        IGH_Component Component
        int Iteration

      Methods (Virtual & overridable):
        Print(string text)
        Print(string format, params object[] args)
        Reflect(object obj)
        Reflect(object obj, string method_name)
    */
    #endregion

    private void RunScript(object geo, ref object guid)
    {
        Guid newGuid = Guid.NewGuid();

        // Write your logic here
        guid = newGuid;
    }
}
# ---------- end c_script ----------

# ---- group: CarboCalc
panel_7 = Panel("Steel")
material_3 = Materials({"Concrete - Mortar/screed": 0, "Concrete UK - C40/50 - Precast": 1, "Concrete UK - C32/40 - 25% GGBS": 2, "Concrete UK - C25/30 - 25% GGBS": 3, "Concrete UK - C20/25 - 25% GGBS": 4, "Concrete UK - C16/20 - 25% GGBS": 5, "Concrete UK - C40/50 - 25% GGBS": 6, "Concrete - C32/40 Mean": 7, "Concrete UK - C40/50 - Precast 150mm Hollowcore": 8, "Steel UK - Reinforcement": 9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}, selected="Concrete UK - C32/40 - 25% GGBS")
list_all_materials = ListMaterials(MaterialTemplate=panel)
list_all_materials_2 = ListMaterials(MaterialTemplate=panel)
geo_3 = Geometry([geo, move_5.Geometry])
geo_4 = Geometry([move_6.Geometry, geo_2])
item = ListItem(List=list_all_materials_2, Index=material_3, Wrap=True)
item_2 = ListItem(List=list_all_materials, Index=0, Wrap=True)

# ----
panel_9 = Panel(list_all_materials)
c_script_2 = CSharpScript(geo=geo_4)  # -> out, guid; same code as c_script

# ---- group: CarboCalc (continued)
id = Guid(c_script_2.guid)

panel_10 = Panel(item)
panel_11 = Panel("1111")
panel_12 = Panel(panel_6)
panel_13 = Panel("Floor")
panel_14 = Panel(item_2)
carbo_life_element = CarboLifeElement(IdGUID="1111", ElementName="RC Slab", MaterialName=panel_10, Volume=volume_2.Volume, Category="Floor", GUID=id)  # -> CarboElement, Message
carbo_life_element_2 = CarboLifeElement(
    IdGUID=panel_11,
    ElementName=panel_12,
    MaterialName=panel_14,
    Volume=volume.Volume,
    Category=panel_13,
    GUID=c_script.guid)  # -> CarboElement, Message
panel_15 = Panel(carbo_life_element.CarboElement)
panel_16 = Panel(carbo_life_element.Message)
panel_17 = Panel(carbo_life_element_2.CarboElement)
panel_18 = Panel(carbo_life_element_2.Message)

# ----
carbo_life_geo_element = CarboLifeGeoElement(IdGUID=panel_11, ElementName=panel_6, MaterialName=panel_14, Geometry=geo_3, Category=panel_13)  # -> CarboElement, Message

# ---- group: Create Project By Groups
material_4 = Materials({"Concrete - Mortar/screed": 0, "Concrete UK - C40/50 - Precast": 1, "Concrete UK - C32/40 - 25% GGBS": 2, "Concrete UK - C25/30 - 25% GGBS": 3, "Concrete UK - C20/25 - 25% GGBS": 4, "Concrete UK - C16/20 - 25% GGBS": 5, "Concrete UK - C40/50 - 25% GGBS": 6, "Concrete - C32/40 Mean": 7, "Concrete UK - C40/50 - Precast 150mm Hollowcore": 8, "Steel UK - Reinforcement": 9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}, selected="Steel - Generic": 82)
material_5 = Materials({"Concrete - Mortar/screed": 0, "Concrete UK - C40/50 - Precast": 1, "Concrete UK - C32/40 - 25% GGBS": 2, "Concrete UK - C25/30 - 25% GGBS": 3, "Concrete UK - C20/25 - 25% GGBS": 4, "Concrete UK - C16/20 - 25% GGBS": 5, "Concrete UK - C40/50 - 25% GGBS": 6, "Concrete - C32/40 Mean": 7, "Concrete UK - C40/50 - Precast 150mm Hollowcore": 8, "Steel UK - Reinforcement": 9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}, selected="Concrete UK - C32/40 - 25% GGBS")
list_all_materials_3 = ListMaterials()
list_all_materials_4 = ListMaterials()
item_3 = ListItem(List=list_all_materials_3, Index=material_4, Wrap=True)
item_4 = ListItem(List=list_all_materials_4, Index=material_5, Wrap=True)
select_a_carbomaterial = SelectMaterials(MaterialName=item_4, MaterialCategory="Concrete")  # -> CM, String
select_a_carbomaterial_2 = SelectMaterials(MaterialName=item_3, MaterialCategory="Steel")  # -> CM, String
create_a_carbogroup = CarboGroup(CarboElement=carbo_life_element_2.CarboElement, CarboMaterial=select_a_carbomaterial_2.CM)  # -> CarboGroup, Message
create_a_carbogroup_2 = CarboGroup(CarboElement=carbo_life_element.CarboElement, CarboMaterial=select_a_carbomaterial.CM)  # -> CarboGroup, Message
carbo_life_group_project_solver = ProjectGroupSolver(
    CarboGroups=[create_a_carbogroup.CarboGroup, create_a_carbogroup_2.CarboGroup],
    Switches=carbo_life_switches.CarboSwitches,
    Uncertainty=0)  # -> Total, CarboProject, Message
panel_19 = Panel(carbo_life_group_project_solver.Total)

# ---- group: CarboCalc (continued)
carbo_life_project_solver_by_elements = ProjectElementSolver(
    CarboElements=[carbo_life_element_2.CarboElement, carbo_life_geo_element.CarboElement],
    Switches=carbo_life_switches.CarboSwitches,
    TemplatePath=panel,
    Uncertainty=Slider(0.1, range=0..1))  # -> Total, CarboProject, Message, Txt

# ----
panel_20 = Panel(carbo_life_project_solver_by_elements.CarboProject)
panel_21 = Panel(carbo_life_project_solver_by_elements.Message)
panel_22 = Panel(carbo_life_project_solver_by_elements.Total)
split = TextSplit(Text=panel_21, Separators=";")  # -> simplify(Result)
panel_23 = Panel(split)
int = Integer(1)
item_5 = ListItem(List=panel_23, Index=int, Wrap=True)
flatten = FlattenTree(Tree=item_5, Path="{0}")
panel_24 = Panel(flatten)
normalise = CSharpScript(x=panel_24)  # -> out, A; inputs x: list of Double
# ---------- normalise: C# ----------
    List<double> result = new List<double>();

    foreach(double nr in x)
    {
      if(nr < 0)
      {
        result.Add(Math.Round(nr * -1,1));
      }

      if(nr > 0)
      {
        result.Add(Math.Round(nr,1));
      }

    }
    A = result;
# ---------- end normalise ----------
panel_25 = Panel(normalise.A)
repeat = RepeatData(Data=graft(normalise.A), Length=graft(normalise.A))  # -> flatten(Data)
pie = PieChart(repeat)

panel_26 = Panel(carbo_life_project_solver_by_elements.Txt)
panel_27 = Panel(select_a_carbomaterial.String)
panel_28 = Panel(select_a_carbomaterial_2.String)

# ---- group: Save Project
save_project = SaveACarboLifeProject(Project=carbo_life_group_project_solver.CarboProject, Path="C:\Temp\RhinoSave.clcx", Save=Toggle(True))
panel_29 = Panel(save_project)

# ----
split_2 = TextSplit(Text=carbo_life_group_project_solver.Message, Separators=";")  # -> simplify(Result)
panel_30 = Panel(split_2)
int_2 = Integer(1)
item_6 = ListItem(List=panel_30, Index=int_2, Wrap=True)
flatten_2 = FlattenTree(Tree=item_6, Path="{0}")
panel_31 = Panel(flatten_2)
normalise_2 = CSharpScript(x=panel_31)  # -> out, A; inputs x: list of Double; same code as normalise
panel_32 = Panel(normalise_2.A)
repeat_2 = RepeatData(Data=graft(normalise_2.A), Length=graft(normalise_2.A))  # -> flatten(Data)
pie_2 = PieChart(repeat_2)
